# Grasshopper definition godot_exporter.gh (Grasshopper 0.9.76)
# plug-ins: Python Interpreter

srf = Surface([<surface referenced from the Rhino model> x1032])
edges = BrepEdges(Brep=srf)  # -> Naked, Interior, NonManifold
line = Line(edges.Naked)
number_slider = Slider(15, range=0..100)
null = NullItem(Item=line)  # -> NullFlags, InvalidFlags, Description
dispatch = Dispatch(List=edges.Naked, DispatchPattern=null.NullFlags)  # -> ListA, ListB
topoly = CurveToPolyline(Curve=dispatch.ListA, ToleranceDistance=Slider(0.25, range=0..1), ToleranceAngle=0)  # -> Polyline, Segments
merge = Merge(Data1=topoly.Polyline, Data2=dispatch.ListB)
join = JoinCurves(Curves=merge, Preserve=False)  # -> simplify(Curves)
len = Length(Curve=join)
sort = SortList(Keys=len, ValuesA=join)  # -> Keys, ValuesA
rev = ReverseList(List=sort.ValuesA)
item = ListItem(List=rev, Index=0, Wrap=True)
disc = Discontinuity(Curve=item, Level=1)  # -> simplify(Points), Parameters
lng = ListLength(List=disc.Points)
equals = Equality(FirstNumber=lng, SecondNumber="0")  # -> Equality, Inequality
tstat = TreeStatistics(Tree=item)  # -> Paths, Length, Count
dispatch_2 = Dispatch(List=tstat.Paths, DispatchPattern=flatten(equals.Equality))  # -> ListA, ListB
branch = TreeBranch(Tree=item, Path=dispatch_2.ListB, MaintainPaths=True)
bbox = BoundingBox(Content=branch, Plane=PlaneXY(0, 0, 0))  # -> Box, Box_2
disc_2 = Discontinuity(Curve=branch, Level=1)  # -> simplify(Points), Parameters
shift = ShiftList(List=disc_2.Points, Shift=1, Wrap=True)
boxprop = BoxProperties(Box=bbox.Box)  # -> simplify(Center), Diagonal, Area, Volume, Degeneracy
pdecon = Deconstruct(Point=disc_2.Points)  # -> XComponent, YComponent, ZComponent
pdecon_2 = Deconstruct(Point=shift)  # -> XComponent, YComponent, ZComponent
addition = Addition(A=pdecon.YComponent, B=pdecon_2.YComponent)
subtraction = Subtraction(A=pdecon_2.XComponent, B=pdecon.XComponent)
multiplication = Multiplication(A=addition, B=subtraction)
ma = MassAddition(Input=multiplication)  # -> Result, PartialResults
rev_2 = ReverseList(List=disc_2.Points)
smaller = SmallerThan(FirstNumber=ma.Result, SecondNumber="0")  # -> SmallerThan, OrEqualTo
weave = Weave(Pattern=smaller.SmallerThan, Stream0=rev_2, Stream1=disc_2.Points, NullGaps=False)
vec2pt = Vector2Pt(PointA=boxprop.Center, PointB=weave, Unitize=False)  # -> Vector, Length
pdecon_3 = Deconstruct(Point=vec2pt.Vector)  # -> XComponent, YComponent, ZComponent
lng_2 = ListLength(List=flatten(branch))
pdecon_4 = Deconstruct(Point=boxprop.Center)  # -> XComponent, YComponent, ZComponent
neg = Negative(Value=pdecon_3.YComponent)
series = Series(Start=0, Step=1, Count=lng_2)
neg_2 = Negative(Value=pdecon_4.YComponent)

# ---- group: relative vertex X
num = Number(pdecon_3.XComponent)

# ---- group: relative vertex Y
num_2 = Number(neg)

# ----
int = Integer(series)
concat = Concatenate(FragmentA=num, FragmentB=", ", FragmentC=num_2)
addition_2 = Addition(A="1000", B=int)
panel = Panel(""" )
uv = Vector2Array(  )
color = Color( 1, 1, 1, 1 )
vertex_colors = ColorArray(  )
offset = Vector2( 0, 0 )
texture/texture = null
texture/offset = Vector2( 0, 0 )
texture/scale = Vector2( 1, 1 )
texture/rotation = 0.0
invert/enable = false
invert/border = 100.0""")
panel_2 = Panel(""" )
polygon = Vector2Array( """)
panel_3 = Panel("""" type="Polygon2D" parent="."]

transform/pos = Vector2( """)

# ---- group: centerY
num_3 = Number(neg_2)

# ---- group: centerX
num_4 = Number(pdecon_4.XComponent)

# ---- group: name
txt = Text(addition_2)

# ----
join_2 = TextJoin(Text=concat, Join=", ")
concat_2 = Concatenate(FragmentA="house_", FragmentB=txt)
concat_3 = Concatenate(
    FragmentA="[node name=\"",
    FragmentB=graft(concat_2),
    FragmentC=panel_3,
    FragmentD=num_4,
    FragmentE=", ",
    FragmentF=num_3,
    FragmentG=panel_2,
    FragmentH=simplify(join_2),
    FragmentI=panel)  # -> flatten(Result)
partition = PartitionList(List=concat_3, Size=Slider(1300, range=0..1300))  # -> simplify(Chunks)
tstat_2 = TreeStatistics(Tree=partition)  # -> Paths, Length, Count
panel_4 = Panel("""[gd_scene format=1]

[node name="
""")
series_2 = Series(Start="1000", Step=1, Count=tstat_2.Count)
int_2 = Integer(series_2)
concat_4 = Concatenate(FragmentA="group_", FragmentB=int_2)
concat_5 = Concatenate(FragmentA=panel_4, FragmentB=concat_4, FragmentC="\" type=\"Node\"]")  # -> graft(Result)
join_3 = TextJoin(Text=partition)
concat_6 = Concatenate(FragmentD="export/", FragmentA=concat_4, FragmentB=".tscn")  # -> simplify(graft(Result))
concat_7 = Concatenate(FragmentA=concat_5, FragmentB=join_3)  # -> simplify(Result)
txtwrite = TxtWrite(Data=concat_7, Name=concat_6, Write=Button())  # inputs Data: list, Write: Boolean, Reset: Boolean
# ---------- txtwrite: Python ----------
import os
from scriptcontext import sticky as st

# Add a counter variable to sticky
if "count" not in st or Reset:
    st["count"] = 0
    
if Write:
    
    # Use the ghenv variable to get current GH file path
    filePath = ghenv.LocalScope.ghdoc.Path
    fileName = ghenv.LocalScope.ghdoc.Name
    filePath = filePath.replace(".gh","*")
    filePath = filePath.replace(fileName,"")
    
    # Add file name, count and extension
    filePath = os.path.join(filePath,Name)
    
    # Open file
    fileWrite = open(filePath,"w")
    
    # Write text data to file
    for line in Data:
        fileWrite.write(line + "\n")
        
    # Close file
    fileWrite.close()
    
    # Increment count
    st["count"] += 1
# ---------- end txtwrite ----------
